# Grasshopper definition E-ki_hands-on.gh (Grasshopper 1.0.7)

# https://docs.google.com/presentation/d/1inNU7UK449Da8TbRr976Hn_P4hcJU45CW3lINx5dbYI/edit#slide=id.g84adda1071_0_69
c_script = CSharpScript()  # -> out, Layer
# ---------- c_script: C# ----------
    Layer = RhinoDocument.Layers;
# ---------- end c_script ----------
path = FilePath("C:\Users\hnatsume\Desktop\test.fbx")
c_script_2 = CSharpScript(LayerName="New My Layer")  # -> out, LayerObjects; inputs LayerName: String
# ---------- c_script_2: C# ----------
    var layer = RhinoDocument.Layers.FindName(LayerName);
    LayerObjects = RhinoDocument.Objects.FindByLayer(layer);
    Component.ExpireSolution(true);
# ---------- end c_script_2 ----------
c_script_3 = CSharpScript(LayerName="To Layer")  # inputs LayerName: String
# ---------- c_script_3: C# ----------
    var layer = new Rhino.DocObjects.Layer();
    layer.Name = LayerName;
    layer.Color = System.Drawing.Color.Blue;
    RhinoDocument.Layers.Add(layer);
# ---------- end c_script_3 ----------
c_script_4 = CSharpScript(LayerName="New My Layer", path=path)  # inputs LayerName: String, path: String
# ---------- c_script_4: C# usings ----------
using System.Linq;
# ---------- c_script_4: C# ----------
    var layer = RhinoDocument.Layers.FindName(LayerName);

    // メッシュであり対象のレイヤーに存在するオブジェクトを取得
    var filter = new Rhino.DocObjects.ObjectEnumeratorSettings();
    filter.LayerIndexFilter = layer.Index;
    filter.ObjectTypeFilter = Rhino.DocObjects.ObjectType.Mesh;

    // RhinoObjectからguidを取得する
    var rObjs = RhinoDocument.Objects.FindByFilter(filter);
    var guids = rObjs.Select(r => r.Id);

    // 対象オブジェクトを選択する
    RhinoDocument.Objects.UnselectAll();
    RhinoDocument.Objects.Select(guids);

    // export selected
    var opt = new Rhino.FileIO.FileWriteOptions();
    opt.WriteSelectedObjectsOnly = true;
    opt.WriteGeometryOnly = true;

    RhinoDocument.WriteFile(path, opt);
# ---------- end c_script_4 ----------
c_script_5 = CSharpScript(LayerName="New My Layer")  # inputs LayerName: String
# ---------- c_script_5: C# ----------
    var layer = RhinoDocument.Layers.FindName(LayerName);
    var objs = RhinoDocument.Objects.FindByLayer(layer);

    foreach(var obj in objs)
    {
      var surf = obj.Geometry as Surface;
      if(surf != null)
      {
        var attr = new Rhino.DocObjects.ObjectAttributes();
        attr.LayerIndex = layer.Index;

        var mesh = Mesh.CreateFromSurface(surf);
        RhinoDocument.Objects.AddMesh(mesh, attr);
      }
    }
# ---------- end c_script_5 ----------
c_script_6 = CSharpScript(LayerName="New My Layer")  # -> objs; inputs LayerName: String
# ---------- c_script_6: C# ----------
    var layer = RhinoDocument.Layers.FindName(LayerName);

    var filter = new Rhino.DocObjects.ObjectEnumeratorSettings();
    filter.LayerIndexFilter = layer.Index;
    filter.ObjectTypeFilter = Rhino.DocObjects.ObjectType.Mesh;

    var rObjs = RhinoDocument.Objects.FindByFilter(filter);
    var meshes = rObjs.Select(r => r.Geometry).Cast<Mesh>();

    var mesh = new Mesh();
    mesh.Append(meshes);

    var attr = new Rhino.DocObjects.ObjectAttributes();
    attr.LayerIndex = layer.Index;
    RhinoDocument.Objects.AddMesh(mesh, attr);

    foreach(var obj in rObjs)
    {
      RhinoDocument.Objects.Delete(obj);
    }
# ---------- end c_script_6 ----------
c_script_7 = CSharpScript(FromName="To Layer", ToName="New My Layer")  # inputs FromName: String, ToName: String
# ---------- c_script_7: C# ----------
    var fromL = RhinoDocument.Layers.FindName(FromName);
    var toL = RhinoDocument.Layers.FindName(ToName);
    
    Rhino.DocObjects.RhinoObject[] objs = RhinoDocument.Objects.FindByLayer(fromL);
  
    foreach(var obj in objs)
    {
      obj.Attributes.LayerIndex = toL.Index;
      obj.CommitChanges();
    }
# ---------- end c_script_7 ----------
c_script_8 = CSharpScript(LayerName="New My Layer")  # inputs LayerName: String
# ---------- c_script_8: C# ----------
    int index = RhinoDocument.Materials.Add();
    
    // 追加したマテリアルの名称
    var mat = RhinoDocument.Materials[index];
    mat.Name = LayerName;
    mat.CommitChanges();
    
    // レイヤーにマテリアルを設定
    var layer = RhinoDocument.Layers.FindName(LayerName);
    layer.RenderMaterialIndex = index;
# ---------- end c_script_8 ----------
panel = Panel(c_script.Layer)
panel_2 = Panel(c_script_6)
panel_3 = Panel(c_script_2.LayerObjects)
