# Grasshopper definition horikawa_handson.gh (Grasshopper 1.0.7)

md_slider = MDSlider(
    SliderMode=0,
    slider_value=Point(0.5563481363, 0.6073397123, 0.5),
    x_domain=Domain(0, 1),
    y_domain=Domain(0, 1),
    z_domain=Domain(0, 1))
number_slider = Slider(300, range=0..1000)
pi = Pi(Factor=Slider(8, range=0..10))
multiplication = Multiplication(A=md_slider, B=Slider(1000, range=0..1000))
range = Range(Domain=Domain(0, 1), Steps=number_slider)
c_script = CSharpScript(
    pos=multiplication,
    dist=Slider(1000, range=0..1000),
    num=Slider(530, range=0..1000),
    ang=pi,
    angpow=Slider(0.84, range=0..2),
    topoffset=Slider(849, range=0..1000),
    minlength=Slider(76, range=0..1000),
    maxlength=Slider(2873, range=0..10000),
    lengthpow=Slider(7.3, range=0..10))  # -> out, Rail, A; inputs pos: Point3d, dist: Double, num: Int32, ang: Double, angpow: Double, topoffset: Double, minlength: Double, maxlength: Double, lengthpow: Double
# ---------- c_script: C# ----------
    var pts = new List<Point3d>();

    for(int i = 0; i < num; i++)
    {
      double t = i / (num - 1.0);
      var newpos = pos + new Point3d(t * dist, 0, 0);

      Point newpt = new Point(newpos);
      double angmult = Math.Pow(t, angpow);
      double rotang = angmult * ang;
      newpt.Rotate(rotang, Vector3d.ZAxis, pos);

      pts.Add(newpt.Location);
    }

    Curve crv = Curve.CreateInterpolatedCurve(pts, 3);
    var crvlen = crv.GetLength();
    var diam = crvlen / num;

    var newpts = new List<Point3d>();
    var lines = new List<Curve>();
    var pipeList = new List<Brep>();
    var divs = crv.DivideByCount(num, true);
    for(int i = 0; i < divs.Length; i++)
    {
      double t = i / (divs.Length - 1.0);
      double div = divs[i];

      var newpos = crv.PointAt(div);
      newpos = newpos + new Point3d(0, 0, -topoffset * t);

      var len = minlength + (maxlength - minlength) * Math.Pow((1.0 - t), lengthpow);
      var lc = new LineCurve(newpos, newpos + new Point3d(0, 0, -len));

      var pipes = Brep.CreatePipe(lc, diam * 0.5, true, PipeCapMode.None, true, 0.01, 0.01);
      pipeList.Add(pipes[0]);
      
      newpts.Add(newpos);
      lines.Add(lc);
    }

    crv = Curve.CreateInterpolatedCurve(newpts, 3);
    var railPipe = Brep.CreatePipe(crv, diam * 0.5, true, PipeCapMode.None, true, 0.01, 0.01);

    A = pipeList;
    Rail = railPipe;
# ---------- end c_script ----------
multiplication_2 = Multiplication(A=Slider(1000, range=0..1000), B=range)
num = Number(range)
pi_2 = Pi(Factor=Slider(10, range=0..10))
pow = Power(A=range, B=Slider(1.3, range=0..10))
dom = ConstructDomain(DomainStart=Slider(5000, range=0..10000), DomainEnd=Slider(200, range=0..1000))
pow_2 = Power(A=num, B=Slider(0.3, range=0..10))
panel = Panel(c_script.out)
panel_2 = Panel(c_script.Rail)
panel_3 = Panel(multiplication_2)
panel_4 = Panel(c_script.A)
pt = ConstructPoint(XCoordinate=multiplication_2, YCoordinate=0, ZCoordinate=0)
remap = RemapNumbers(Value=pow_2, Source=Domain(0, 1), Target=dom)  # -> Mapped, Clipped
multiplication_3 = Multiplication(A=pow, B=pi_2)
rotate = Rotate(Geometry=pt, Angle=multiplication_3, Plane=PlaneXY(0, 0, 0))  # -> Geometry, Transform
intcrv = Interpolate(Vertices=rotate.Geometry, Degree=3, Periodic=False, KnotStyle=1)  # -> Curve, Length, Domain
multiplication_4 = Multiplication(A=range, B=Slider(1000, range=0..1000))
preview = CustomPreview(Geometry=[c_script.Rail, c_script.A], Material=ColourSwatch(SwatchColor=RGB(112, 217, 255)))
Z = UnitZ(Factor=multiplication_4)
divide = DivideCurve(Curve=intcrv.Curve, Count=number_slider, Kinks=False)  # -> Points, Tangents, Parameters
neg = Negative(Value=Z)
Z_2 = UnitZ(Factor=1)
item = ListItem(List=divide.Points, Index=0, Wrap=True)  # -> Item, Item1
move = Move(Geometry=divide.Points, Motion=neg)  # -> Geometry, Transform
neg_2 = Negative(Value=Z_2)
pline = PolyLine(Vertices=[item.Item, item.Item1], Closed=False)
intcrv_2 = Interpolate(Vertices=move.Geometry, Degree=3, Periodic=False, KnotStyle=1)  # -> Curve, Length, Domain
len = Length(Curve=pline)
line = LineSDL(Start=move.Geometry, Direction=neg_2, Length=remap.Mapped)
multiplication_5 = Multiplication(A=len, B=0.5)
merge = Merge(Data1=intcrv_2.Curve, Data2=line)
pipe = Pipe(Curve=merge, Radius=multiplication_5, Caps=1)
preview_2 = CustomPreview(
    Geometry=pipe,
    Material={diffuse=RGB(221, 160, 221), emission=RGB(66, 48, 66), shine=0.5, specular=RGB(255, 255, 255), transparency=0})
