# Grasshopper definition kobayashi_hands-on.gh (Grasshopper 1.0.7)

number_slider = Slider(10, range=0..10)
# 最初のレイヤーは小さくすることが
# 3Dプリントの鉄則なので、
# ここでは最小が0.1
number_slider_2 = Slider(0.1, range=0..0.1)
series = Series(Start=number_slider_2, Step=Slider(0.2, range=0..1), Count=Slider(50, range=0..100))
crv = Curve(<curve referenced from the Rhino model>)
Z = UnitZ(Factor=series)
rectangle = Rectangle(Plane=PlaneXY(0, 0, 0), XSize=Slider(300, range=0..1000), YSize=Slider(300, range=0..1000), Radius=0)  # -> Rectangle, Length
move = Move(Geometry=crv, Motion=Z)  # -> Geometry, Transform
python = GhPythonScript(input_path=move.Geometry, division_length=Slider(2, range=0..10))  # -> out, a; inputs input_path: list
# ---------- python: Python ----------
import rhinoscriptsyntax as rs

input_path = _input_path
devision_length = _division_length

def _extract_points(path):
    points = []
    if rs.IsPolyline(path):
        points = rs.PolylineVertices(path)
    elif rs.IsCurve(path):
        points = rs.DivideCurveLength(path, _division_length)
    return points

def main(input_path):
    points_list = []
    for path in input_path:
        points_list.append(_extract_points(path))
    return points_list

if __name__=='__main__':
    points_list = main(input_path)
    a = points_list
# ---------- end python ----------
python_2 = GhPythonScript(input_path=python.a)  # -> out, a; inputs input_path: list
# ---------- python_2: Python ----------
a = _input_path[0]
# ---------- end python_2 ----------
panel = Panel(python.a)
panel_2 = Panel(python_2.a)
path = FilePath("C:\Users\hnatsume\Desktop\")
concat = Concatenate(FragmentA=path, FragmentB="test.gcode")
python_3 = GhPythonScript(
    write=Button(),
    filepath=concat,
    points=python.a,
    extruder_temp=Slider(200, range=0..1000),
    bed_temp=Slider(60, range=0..100),
    F=Slider(3600, range=0..10000),
    adjustE=Slider(1.3, range=0..10))  # -> out, a; inputs points: list
# ---------- python_3: Python ----------
import rhinoscriptsyntax as rs
import math

# input
write = _write
filepath = _filepath
points = _points
extruder_temp = _extruder_temp
bed_temp = _bed_temp
F = _F
adjustE = _adjustE

# 家庭用の一般的なサイズを使用
nozzle_width = 0.4
layer_height = 0.2
filament_diameter = 1.75
F_G0 = 7600


def startcode(gcode):
    """ スタートコードの記述
    """
    gcode.append(";FLAVOR:Marlin\n")
    # based on "Prusa i3 MK3"
    # print setting
    gcode.append("M82\n") # absolute extrusion mode
    gcode.append("G21\n") # set units to millimeters
    gcode.append("G90\n") # use absolute positioning
    gcode.append("M82\n") # absolute extrusion mode
    # temparature
    gcode.append("M104 S{}\n".format(extruder_temp)) # set extruder temp
    gcode.append("M140 S{}\n".format(bed_temp)) # set bed temp
    gcode.append("M190 S{}\n".format(bed_temp)) # wait for bed temp
    gcode.append("M109 S{}\n".format(extruder_temp)) # wait for extruder temp
    # position
    gcode.append("G28\n") # home all without mesh bed level
    gcode.append("G80\n") # mesh bed leveling
    gcode.append("G92 E0.0\n") # reset extruder distance position
    gcode.append("G1 Y-3.0 F1000.0\n") # go outside print area
    gcode.append("G1 X60.0 E9.0 F1000.0\n") # intro line
    gcode.append("G1 X100.0 E21.5 F1000.0\n") # intro line
    gcode.append("G92 E0.0\n") # reset extruder distance position
    gcode.append("G92 E0\n")
    gcode.append("G92 E0\n")
    gcode.append("G1 F2100 E-0.8\n")
    gcode.append("M106\n") # Fan On
    
    gcode.append("M83\n") # relative extrusion mode


def endcode(gcode):
    """ エンドコードの記述
    """
    gcode.append("G1 F2100 E-1\n") # retraction
    gcode.append("M140 S0\n")
    gcode.append("M107\n")
    gcode.append("M104 S0\n") # turn off extruder
    gcode.append("M140 S0\n") # turn off heatbed
    gcode.append("M107\n") # turn off fan
    gcode.append("G1 X0 Y210\n") # home X axis and push Y forward
    gcode.append("M84\n") # disable motors
    gcode.append("M82\n") #absolute extrusion mode
    gcode.append("M104 S0\n")


def printcode(gcode):
    """ Gコードを記述
    """
    for path in points:
        for i, pt in enumerate(path):
            if i == 0:
                # G0
                gcode.append("G0 X{0:.3f} Y{1:.3f} Z{2:.3f} F{3}\n".format(pt[0], pt[1], pt[2], F_G0))
            else:
                # G1
                length = rs.Distance(pt, path[i - 1]) 
                E = nozzle_width * layer_height * length / ((filament_diameter / 2)**2 * math.pi)
                E = adjustE * E
                gcode.append("G0 X{0:.3f} Y{1:.3f} Z{2:.3f} E{3:.3f} F{4}\n".format(pt[0], pt[1], pt[2], E, F))


def export_gcode(gcode):
    """ 作成したデータの書き出し
    """
    if write is True:
        with open(filepath, "w") as f:
            f.writelines(gcode)


if __name__=='__main__':
    gcode = []
    startcode(gcode)
    printcode(gcode)
    endcode(gcode)
    export_gcode(gcode)
    
    a = gcode
# ---------- end python_3 ----------
panel_3 = Panel(python_3.a)
