# Grasshopper definition C#_function composability session_user_.gh (Grasshopper 1.0.7)
# plug-ins: Fattener, LunchBox, Weaverbird, Mesh Pipe

number_slider = Slider(30, range=0..100)  # disabled
# Example 1 - voronoi cube
box = CenterBox(Base=PlaneXY(0, 0, 0), X=number_slider, Y=number_slider, Z=number_slider)  # disabled
pop3d = Populate3D(Region=box, Count=100, Seed=1)  # disabled
voronoi³ = Voronoi3D(Points=pop3d, Box=box)  # -> Cells, Boundary; disabled
wires = BrepWireframe(Brep=voronoi³.Cells, Density=-1)  # -> flatten(Wireframe); disabled
F = Fatten(Skeleton=wires, Thickness=1, LengthSubdivisions=0, EndType=2, AdjustForAngle=False)  # disabled
number_slider_2 = Slider(2, range=0..10)  # disabled
wbcatmullclark = WeaverbirdsCatmullClarkSubdivision(MeshCurves=F, Level=number_slider_2, SmoothNakedEdges=1)  # disabled

panel = Panel("Populate3D")  # disabled
panel_2 = Panel("Voronoi3D")  # disabled
panel_3 = Panel("WeaverBird_WeaverbirdsCatmullClarkSubdivision")  # disabled
number_slider_3 = Slider(2, range=0..10)  # disabled
panel_4 = Panel("CenterBox")  # disabled
panel_5 = Panel("BrepWireframe")  # disabled
panel_6 = Panel("Fattener_Fatten")  # disabled
c_script = CSharpScript(st=panel_4, st2=panel, st3=panel_2, st4=panel_5, st5=panel_6, st6=panel_3, level=number_slider_3)  # -> out, A; inputs st: String, st2: String, st3: String, st4: String, st5: String, st6: String, st7: String, level: Int32; disabled
# ---------- c_script: C# usings ----------
using Rhino.NodeInCode;
using System.Drawing;
# ---------- c_script: C# ----------
    string[] w;
    var com1 = Components.FindComponent(st);
    var com2 = Components.FindComponent(st2);
    var com3 = Components.FindComponent(st3);
    var com4 = Components.FindComponent(st4);
    var com5 = Components.FindComponent(st5);
    var com6 = Components.FindComponent(st6);

    if(com1 == null) Print("com1");
    
    var ot1 = com1.Evaluate(new object[] {Plane.WorldXY, 20, 20, 20}, true, out w);
    var ot2 = com2.Evaluate(new object[] {ot1[0], 30}, true, out w);
    var ot3 = com3.Evaluate(new object[] {ot2[0], ot1[0]}, true, out w);
    var ot4 = com4.Evaluate(new object[] {ot3[0]}, true, out w);
    var ot5 = com5.Evaluate(new object[] {ot4[0]}, true, out w);
    var ot6 = com6.Evaluate(new object[] {ot5[0], 3}, true, out w);
    
    A = ot6[0];
# ---------- end c_script ----------
panel_7 = Panel(c_script.A)  # disabled
geo = Geometry(c_script.A)  # disabled

panel_8 = Panel(c_script.out)  # disabled

# ----
# Example 2 - data matching
geo_2 = Geometry(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)
hex = HexagonCells(Surface=geo_2, UDivisions=Slider(10, range=0..10), VDivisions=Slider(8, range=0..10), TParameter=0.25)  # -> HexagonCells, Centers
mpipe = MeshPipe(Curve=hex.HexagonCells, Radius=Slider(1, range=0..10), Accuracy=0.2, Rotation=0, Segments=10, Caps=2)
mcol = MeshColours(Mesh=mpipe, Colours=ColourSwatch(SwatchColor=RGB(255, 159, 140)))

number_slider_4 = Slider(1, range=0..10)  # disabled
number_slider_5 = Slider(10, range=0..10)  # disabled
number_slider_6 = Slider(8, range=0..10)  # disabled
panel_9 = Panel("CustomPreview")  # disabled
panel_10 = Panel("MeshColours")  # disabled
swatch = ColourSwatch(SwatchColor=RGB(255, 159, 140))  # disabled
geo_3 = Geometry(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)  # disabled
txt = Text("LunchBox_HexagonCells")  # disabled
txt_2 = Text("MeshPipe_MeshPipe")  # disabled
panel_11 = Panel(txt)  # disabled
panel_12 = Panel(txt_2)  # disabled
c_script_2 = CSharpScript(st=txt, srf=geo_3, u=number_slider_5, v=number_slider_6, st2=txt_2, radius=number_slider_4, col=swatch, st3=panel_10)  # -> out, A, B; inputs st: String, srf: Surface, u: Int32, v: Int32, st2: String, radius: Double, col: Color, st3: String; disabled
# ---------- c_script_2: C# ----------
    string[] w;
    var com1 = Components.FindComponent(st);
    var com2 = Components.FindComponent(st2);
    
    var ot1 = com1.Evaluate(new object[] {srf, u, v}, false, out w);
    var ot2 = com2.Evaluate(new object[] {ot1[0], 0.5}, false, out w);
    
    var ot2c = ot2[0] as IList<object>;
    int counter = 0;
    var finalmesh = new List<object>();
    
    foreach (var c in ot2c)
    {
      Random rg = new Random(counter);
      
      Color co = Color.FromArgb(rg.Next(0, 255), rg.Next(0, 255), rg.Next(0, 255), rg.Next(0, 255));
      //colours.Add(co);
            
      var ot3 = com2.Evaluate(new object[] {ot2[0], co}, false, out w);
      
      var ot3c = ot3[0] as IList<object>;
      finalmesh.AddRange(ot3c);
      counter++;
    }
    
    A = finalmesh;
# ---------- end c_script_2 ----------
viewer = ParamViewer(c_script_2.A)  # disabled
panel_13 = Panel(c_script_2.A)  # disabled
panel_14 = Panel(c_script_2.B)  # disabled

# ----
# Example 3 - geometry composition
toggle = BooleanToggle(True)
# Thank you!!!!
pt = Point([Point(10.6494652, 11.37931414, 12.06592662), Point(4.185768814, 7.441660022, 0), Point(18.52477343, 4.395550233, 0)])
c_script_3 = CSharpScript(reset=toggle, number=Slider(4, range=1..5), rand=Slider(40, range=0..100), pp=pt)  # -> out, A, B; inputs reset: Boolean, number: Int32, rand: Int32, pp: list of Point3d
# ---------- c_script_3: C# usings ----------
using System.Linq;
using Rhino.NodeInCode;
# ---------- c_script_3: C# ----------
    string[] w;

    var A1 = Components.FindComponent("Circle");
    var A2 = Components.FindComponent("Polygon");
    var A3 = Components.FindComponent("Rectangle");

    var B1 = Components.FindComponent("DivideCurve");
    var B2 = Components.FindComponent("ControlPoints");
    var B3 = Components.FindComponent("EndPoints");

    var CP = Components.FindComponent("ClosestPoint");
    var L = Components.FindComponent("Line");
    var FT = Components.FindComponent("Fattener_Fatten");
    var WB = Components.FindComponent("WeaverBird_WeaverbirdsCatmullClarkSubdivision");

    if (A1 == null) Print("A1");
    if (A2 == null) Print("A2");
    if (A3 == null) Print("A3");
    if (B1 == null) Print("B1");
    if (B2 == null) Print("B2");
    if (B3 == null) Print("B3");
    if (CP == null) Print("CP");
    if (L == null) Print("L");
    if (FT == null) Print("FT");
    if (WB == null) Print("WB");
    
    var G1 = new object[]{A1, A2, A3};
    var G2 = new object[]{B1, B2, B3};
    
    var pts = new List<Point3d> {Point3d.Origin};
    var ptTree = new DataTree<Point3d>();
    
    for (int i = 0; i < number; i++)
    {
      var rg1 = new Random(5 + rand);
      var rg2 = new Random(7 + rand);
    
      var r1 = rg1.Next(0, 3);
      var r2 = rg1.Next(0, 3);
    
      var obj1 = (ComponentFunctionInfo) G1[r1];
      var obj2 = (ComponentFunctionInfo) G2[r2];
    
      Print("{0} + {1}", obj1.Name, obj2.Name);
    
      var ot1 = obj1.Evaluate(new object[]{pts}, false, out w);
      var ot2 = obj2.Evaluate(new object[]{ot1[0]}, false, out w);
      
      var ot2c = ot2[0] as IList<object>;
      var tempts = new List<Point3d>();
      
      var path = new GH_Path(i);
      
      int counter = 0;
      foreach(var p in ot2c)
      {
        var rg3 = new Random(counter);
        double h = (rg3.NextDouble() - 0.5) * 2.5;
        Point3d pt = (Point3d) p;
        tempts.Add(pt);
      }
      ptTree.AddRange(tempts, path);
      pts = new List<Point3d>(tempts);
    }
    
    var flatten = new List<Point3d>();
    
    foreach(var pa in ptTree.Path)
    {
      foreach (var pt in ptTree.Branch(pa))
      {
        flatten.Add(pt);
      }
    }
    var avpt = new Point3d(flatten.Average(p => p.X), flatten.Average(p => p.Y), flatten.Average(p => p.Z));
    
    GH_Path newpath = new GH_Path(number);
    
    ptTree.Add(avpt, newpath);
    
    var lines = new List<object>();
    var sphere = new List<Sphere>();
    
    for(int i = 0; i < number - 1;i++)
    {
      var ot3 = CP.Evaluate(new object[] {ptTree.Branch(ptTree.Path[i]), ptTree.Branch(ptTree.Path[i + 1])}, true, out w);
      var ot4 = L.Evaluate(new object[] {ptTree.Branch(ptTree.Path[i]), ptTree.Branch(ptTree.Path[i + 1])}, false, out w);
      
      var ot4c = ot4[0] as IList<object>;
      lines.AddRange(ot4c);
      
      foreach(var l in ot4c)
      {
        var ll = (Line) l;
        sphere.Add(new Sphere(ll.PointAt(0), 0.15));
      }
    }
    
    //A = pts;
    B = ptTree;
# ---------- end c_script_3 ----------

panel_15 = Panel(c_script_3.out)

# ----
# 2020/06/13 Google Drive:
# https://drive.google.com/open?id=16SBwSGzBacYTckU6d1tvKlzk2k6R7crT
number_slider_7 = Slider(3, range=0..10)  # disabled
number_slider_8 = Slider(0.5, range=0..1)  # disabled
cir = Circle(Plane=PlaneXY(0, 0, 0), Radius=number_slider_7)  # disabled
number_slider_9 = Slider(0.1, range=0..1)  # disabled

# ----
# GH component approach
# RhinoCommon approach
# NodeInCode approach
number_slider_10 = Slider(10, range=0..500)

# ----
# 1. NodeInCode syntax
divide = DivideCurve(Curve=cir, Count=number_slider_10, Kinks=False)  # -> Points, Tangents, Parameters; disabled
cir_2 = Circle(Plane=divide.Points, Radius=number_slider_8)  # disabled
divide_2 = DivideCurve(Curve=cir_2, Count=number_slider_10, Kinks=False)  # -> Points, Tangents, Parameters; disabled
cir_3 = Circle(Plane=divide_2.Points, Radius=number_slider_9)  # disabled

c_script_4 = CSharpScript(Num=number_slider_10)  # -> Out, A; disabled

c_script_5 = CSharpScript(num=number_slider_10)  # -> out, A; inputs num: Int32; disabled
# ---------- c_script_5: C# usings ----------
using Rhino.NodeInCode;
# ---------- c_script_5: C# ----------
    string[] w;
    var com1 = Components.FindComponent("Circle");
    var com2 = Components.FindComponent("DivideCurve");

    var ot1 = com1.Evaluate(new object[] {Point3d.Origin, 10}, true, out w);
    var ot2 = com2.Evaluate(new object[] {ot1[0]}, true, out w);
    var ot3 = com1.Evaluate(new object[] {ot2[0], 3}, true, out w);
    var ot4 = com2.Evaluate(new object[] {ot3[0], 5}, true, out w);
    
    A = ot4[0];
# ---------- end c_script_5 ----------

viewer_2 = ParamViewer(cir_3)  # disabled
viewer_3 = ParamViewer(c_script_4.A)
viewer_4 = ParamViewer(c_script_5.A)

hex_2 = HexagonCells(UDivisions=10, VDivisions=10, TParameter=0.25)  # -> HexagonCells, Centers

# ---- group: check component names
# 2. Name Inspection
c_script_6 = CSharpScript(index=Slider(0, range=0..100), st1="LunchBox", st2="Hexagon", inspect=hex_2.HexagonCells)  # -> out, Sname, All, count, ConnectedName; inputs index: Int32, st1: String, st2: String
# ---------- c_script_6: C# ----------
    var names = Components.NodeInCodeFunctions.GetDynamicMemberNames();
    
    var selnames = names.Where(n=> n.Contains("divide"));  
    
    Print(selnames.ElementAt(index));
    
    Sname = selnames;
# ---------- end c_script_6 ----------

# ----
panel_16 = Panel(c_script_6.out)
panel_17 = Panel(c_script_6.Sname)
panel_18 = Panel(c_script_6.All)
panel_19 = Panel(c_script_6.count)
panel_20 = Panel(c_script_6.ConnectedName)

number_slider_11 = Slider(18, range=0..100)  # disabled
number_slider_12 = Slider(77, range=0..100)  # disabled
rectangle = Rectangle(Plane=PlaneXY(0, 0, 0), XSize=Domain(-1, 1), YSize=Domain(-2, 2), Radius=0)  # -> Rectangle, Length; disabled
pop2d = Populate2D(Region=rectangle.Rectangle, Count=number_slider_11, Seed=number_slider_12)  # disabled
# 3. Access plug-in functionalities
metaball = MetaBall(
    Points=[Point(4.22633273, -2.622759333, 0), Point(7.01630648, 1.905356534, 0), Point(8.952723583, 0.6210295327, 0), Point(11.10682514, -3.298486886, 0), Point(14.72405549, -4.385913969, 0), Point(10.44021599, -5.749843515, 0), Point(5.467518666, -7.302528883, 0), Point(5.376119041, -7.45978376, 0), Point(5.346078999, -4.855512517, 0), Point(3.693276972, -5.06648032, 0)],
    Plane=PlaneXY(0, 0, 0))  # disabled
del = DelaunayMesh(Plane=PlaneXY(0, 0, 0))  # disabled
hull = ConvexHull(Plane=PlaneXY(0, 0, 0))  # -> Hull, HullZ, Indices; disabled
voronoi = Voronoi(BruteForceOverride=False)  # disabled

# ---- group: Convex Hull
c_script_7 = CSharpScript(pt=pop2d)  # -> out, A; inputs pt: list of Point3d; disabled
# ---------- end c_script_7 ----------

# ---- group: Voronoi
c_script_8 = CSharpScript(pt=pop2d)  # -> out, A; inputs pt: list of Point3d; disabled; same code as c_script_7

# ----
panel_21 = Panel(c_script_8.A)  # disabled
panel_22 = Panel(c_script_7.A)  # disabled

# ----
# Cluster A
# Cluster B
# B-1
# A-1
# A-2
# B-2
# A-3
# B-3
number_slider_13 = Slider(6, range=0..10)  # disabled
number_slider_14 = Slider(28, range=0..100)  # disabled
number_slider_15 = Slider(2, range=0..100)  # disabled
random = Random(Range=number_slider_13, Number=1, Seed=number_slider_15)  # disabled
random_2 = Random(Range=number_slider_14, Number=1, Seed=number_slider_15)  # disabled
number_slider_16 = Slider(3, range=0..10)  # disabled
int = Integer(random)  # disabled
int_2 = Integer(random_2)  # disabled
pt_2 = ConstructPoint(XCoordinate=0, YCoordinate=0, ZCoordinate=0)  # disabled
mod = Modulus(A=int, B=number_slider_16)  # disabled
mod_2 = Modulus(A=int_2, B=number_slider_16)  # disabled
gate = StreamGate(Stream=pt_2, Gate=mod)  # -> Target0, Target1, Target2; disabled
panel_23 = Panel("""3 x 3 = 9

A1 - B1
A1 - B2
A1 - B3

A2 - B1
A2 - B2
A2 - B3

A3 - B1
A3 - B2
A3 - B3""")  # disabled

polygon = Polygon(Plane=gate.Target2, Radius=3, Segments=6, FilletRadius=0)  # -> Polygon, Length; disabled
rectangle_2 = Rectangle(Plane=gate.Target0, XSize=Domain(-1, 1), YSize=Domain(-2, 2), Radius=0)  # -> Rectangle, Length; disabled
cir_4 = Circle(Plane=gate.Target1, Radius=1)  # disabled

filter = StreamFilter(Gate=mod, Stream0=rectangle_2.Rectangle, Stream1=cir_4, Stream2=polygon.Polygon)  # disabled
gate_2 = StreamGate(Stream=filter, Gate=mod_2)  # -> Target0, Target1, Target2; disabled

curvepoint = PointOnCurve(gate_2.Target2, parameter=0.5)  # disabled
cp = ControlPoints(Curve=gate_2.Target0)  # -> Points, Weights, Knots; disabled
divide_3 = DivideCurve(Curve=gate_2.Target1, Count=10, Kinks=False)  # -> Points, Tangents, Parameters; disabled

filter_2 = StreamFilter(Gate=mod_2, Stream0=cp.Points, Stream1=divide_3.Points, Stream2=curvepoint)  # disabled
cir_5 = Circle(Plane=filter_2, Radius=1)  # disabled
