# Grasshopper definition qujen_ghgl.gh (Grasshopper 1.0.7)
# plug-ins: ghgl

md_slider = MDSlider(
    SliderMode=0,
    slider_value=Point(0.5908533887, 0.4377245874, 0.5),
    x_domain=Domain(-2, 2),
    y_domain=Domain(-2, 2),
    z_domain=Domain(0, 1))
md_slider_2 = MDSlider(
    SliderMode=0,
    slider_value=Point(0.3875543083, 0.4594304433, 0.5),
    x_domain=Domain(-1, 1),
    y_domain=Domain(-1, 1),
    z_domain=Domain(0, 1))
pdecon = Deconstruct(Point=md_slider)  # -> XComponent, YComponent, ZComponent
pdecon_2 = Deconstruct(Point=md_slider_2)  # -> XComponent, YComponent, ZComponent
pt = Point([Point(-1, -1, -1), Point(1, -1, -1), Point(1, 1, -1), Point(-1, 1, -1)])
pt_2 = ConstructPoint(XCoordinate=pdecon.XComponent, YCoordinate=pdecon.YComponent, ZCoordinate=Slider(2.635, range=0..10))
pt_3 = ConstructPoint(XCoordinate=pdecon_2.XComponent, YCoordinate=pdecon_2.YComponent, ZCoordinate=Slider(-1, range=-1..1))
panel = Panel(pt)
pi = Pi(Factor=1)
X = UnitX(Factor=1)
division = Division(A=pi, B=2)
vrot = Rotate(Vector=pt_3, Axis=X, Angle=division)
gl_shader = GLShader(
    Vertex=pt,
    CamPos=pt_2,
    CamDir=pt_3,
    CamSide=vrot,
    DepthTestingEnabled=True,
    DepthWritingEnabled=True,
    DrawMode=6,
    FragmentShader="""#version 330

in vec4 vertex_color;
out vec4 fragment_color;
uniform vec2 _viewportSize;
uniform vec3 camPos;
uniform vec3 camDir;
uniform vec3 camSide;

const vec3 LIGHT_DIR = normalize(vec3(0.5, 0.8, 1.0));
const vec3 DIFFUSE_COLOR = vec3(0.8);
const float OCCUSION_ITERATIONS = 5.0;
const vec3 AMBIENT_COLOR = vec3(0.1);

// Menger Sponge
float sdCross(vec3 p, float c) {
    p = abs(p);
    float dxy = max(p.x, p.y);
    float dyz = max(p.y, p.z);
    float dxz = max(p.x, p.z);
    return min(dxy, min(dyz, dxz)) - c;
}

float sdBox(vec3 p, vec3 b) {
    p = abs(p) - b;
    return length(max(p, 0.0)) + min(max(p.x, max(p.y, p.z)), 0.0);
}

#define ITERATIONS 5
float deMengerSponge1(vec3 p, float scale, float width) {
    float d = sdBox(p, vec3(1.0));
    float s = 1.0;
    for (int i = 0; i < ITERATIONS; i++) {
        vec3 a = mod(p * s, 2.0) - 1.0;
        s *= scale;
        vec3 r = 1.0 - scale * abs(a);
        float c = sdCross(r, width) / s;
        d = max(d, c);
    }
    return d;
}

float de(vec3 p) {
    return deMengerSponge1(p, 3.0, 1.0);
}
// kokomade

float ambientOcculusion(vec3 p, vec3 normal)
{
    float ao = 0.0;
    float amp = 0.5;
    float step = 0.02;
    for (int i = 1; i < OCCUSION_ITERATIONS; i++)
    {
        vec3 pos = p + step * float(i) * normal;
        float d = de(pos);
        ao += amp * ((step * float(i) - d) / (step * float(i)));
        amp += 0.5;
    }
    return 1.0 - ao;
}

vec3 shaderSurface(vec3 p, vec3 normal)
{
    float dotNL = max(0.0, dot(normal, LIGHT_DIR));
    vec3 dif = DIFFUSE_COLOR * dotNL;
    float ao = ambientOcculusion(p, normal);
    vec3 amb = AMBIENT_COLOR * vec3(ao);
    return dif + amb;
}

vec3 getNormal(vec3 p)
{
	float d = 0.0001;
	return normalize(vec3(
		de(p + vec3(d, 0.0, 0.0)) - de(p + vec3(-d, 0.0, 0.0)),
		de(p + vec3(0.0, d, 0.0)) - de(p + vec3(0.0, -d, 0.0)),
		de(p + vec3(0.0, 0.0, d)) - de(p + vec3(0.0, 0.0, -d))
	));
}

bool raymarch(vec3 ro, vec3 rd, out float t)
{
    vec3 p = ro;
    t = 0.0;
    for(int i= 0; i< 100; i++)
    {
        float d = de(p);
        p += d * rd;
        t += d;
        if(d < 0.001)
        {
            return true;
        }
    }
    return false;    
}

vec3 backGround(vec2 p)
{
    return vec3(0.);
}

void main( void )
{
	vec2 p = (gl_FragCoord.xy * 2.0 - _viewportSize) / min(_viewportSize.x, _viewportSize.y);
    
	vec3 cPos = vec3(camPos.x, camPos.y, camPos.z);
	vec3 cDir = vec3(camDir.x, camDir.y, camDir.z);
	vec3 cUp = vec3(camSide.x, camSide.y, camSide.z);
	vec3 cSide= cross(cDir, cUp);
	
	vec3 ray = normalize(cSide * p.x + cUp * p.y + cDir * 1.5);
	
	float dis = 0.0;
	float rLen = 0.0;
	vec3 rPos = cPos;
    
    vec3 col;
    float t;
    if(raymarch(cPos, ray, t))
    {
        vec3 pos  = cPos + t * ray;
        vec3 normal = getNormal(pos);
        col = shaderSurface(pos, normal);
    }else{
        col = backGround(p);
    }
    fragment_color = vec4(pow(col, vec3(1.0 / 2.2)), 1);
}
		""",
    GLShader=(0, 2, 0),
    PreviewSortOrder=5,
    VertexShader="""#version 330

layout(location = 0) in vec3 vertex;

uniform mat4 _worldToClip;
out vec4 vertex_color;

void main() {
  gl_Position = vec4(vertex, 1.0);
}""",
    glLineWidth=3,
    glPointSize=8)  # -> Color, Depth
