# Grasshopper definition horikawa.gh (Grasshopper 1.0.7)

number_slider = Slider(14, range=0..100)
sph = Sphere(Base=PlaneXY(0, 0, 0), Radius=Slider(100, range=0..100))
popgeo = PopulateGeometry(Geometry=sph, Count=Slider(4, range=0..10), Seed=1)
sph_2 = Sphere(Base=popgeo, Radius=number_slider)
preview = CustomPreview(
    Geometry=sph,
    Material={diffuse=RGB(221, 160, 221), emission=RGB(66, 48, 66), shine=0.5, specular=RGB(255, 255, 255), transparency=0})
c_script = CSharpScript(
    brep=sph,
    attractors=popgeo,
    num=Slider(1000, range=0..1000),
    ite=Slider(100, range=0..100),
    attractor_rad=Slider(200, range=0..200),
    attractor_pow=Slider(-0.69, range=-1..1))  # -> out, A; inputs brep: Brep, attractors: list of Point3d, num: Int32, ite: Int32, attractor_rad: Double, attractor_pow: Double
# ---------- c_script: C# usings ----------
using Rhino.Collections;
# ---------- c_script: C# ----------
    var points = new Point3dList();
    var attracts = new Point3dList(attractors);

    if(brep != null)
    {
      var rnd = new Random();
      var bbox = brep.GetBoundingBox(true);

      for(int i = 0; i < num; i++)
      {
        if(points.Count == 0)
        {
          var rndpt = CreateRandomPoint(rnd, brep, bbox);
          points.Add(rndpt);
        }
        else
        {
          double fdist = -1;
          Point3d fpos = new Point3d();

          for(int t = 0; t < ite; t++)
          {
            var nrndpt = CreateRandomPoint(rnd, brep, bbox);

            var nindex = points.ClosestIndex(nrndpt);
            var npos = points[nindex];
            
            var nattractid = attracts.ClosestIndex(nrndpt);
            var nattractpos = attracts[nattractid];
            
            var nattractdist = Math.Pow(Math.Min(nattractpos.DistanceTo(nrndpt), attractor_rad), attractor_pow);
            
            var ndist = npos.DistanceTo(nrndpt) * nattractdist;
            
            
            

            if (ndist > fdist)
            {
              fdist = ndist;
              fpos = nrndpt;
            }
          }

          points.Add(fpos);
        }

        // var pos = CreateRandomPoint(rnd, brep, bbox);
        // points.Add(pos);
      }
    }

    A = points;
# ---------- c_script: C# additional code ----------
  double Remap(double val, double smin, double smax, double tmin, double tmax)
  {
    return (val - smin) / (smax - smin) * (tmax - tmin) + tmin;
  }

  Point3d CreateRandomPoint(Random rnd, Brep brep, BoundingBox bbox)
  {
    var x = Remap(rnd.NextDouble(), 0.0, 1.0, bbox.Min.X, bbox.Max.X);
    var y = Remap(rnd.NextDouble(), 0.0, 1.0, bbox.Min.Y, bbox.Max.Y);
    var z = Remap(rnd.NextDouble(), 0.0, 1.0, bbox.Min.Z, bbox.Max.Z);

    var pt = brep.ClosestPoint(new Point3d(x, y, z));

    return pt;
  }
# ---------- end c_script ----------
sph_3 = Sphere(Base=c_script.A, Radius=number_slider)
