# Grasshopper definition Karamba_Model.gh (Grasshopper 1.0.7)
# plug-ins: karambaGH

geo = Geometry(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)
explode = Explode(Curve=geo, Recursive=True)  # -> Segments, Vertices
item = ListItem(List=explode.Segments, Index=0, Wrap=True)  # -> Item, Item1, Item2
X = UnitX(Factor=Slider(10, range=0..10))
item_2 = ListItem(List=explode.Vertices, Index=Slider(1, range=0..1), Wrap=True)
item_3 = ListItem(List=explode.Vertices, Index=0, Wrap=True)  # -> Item1, Item
supp = SupportKaramba3D(PosInd=[item_3.Item1, item_3.Item], menu=[buttons(on, on, on, on, off, off)])
beam_joints = BeamJointsKaramba3D(
    ElementIdentifiers="beam2",
    CtKNMAtStartingNode=Vector(0, 0, 0),
    CrKNmRadAtStartingNode=Vector(0, 0, 0),
    CtKNMAtEndNode=Vector(0, 0, 0),
    CrKNmRadAtEndNode=Vector(0, 0, 0),
    menu=[buttons(off, off, off, on, on, on), buttons(off, off, off, on, on, on)])
loads = LoadsKaramba3D(ForceVector=X, Local=False, PosInd=item_2, LCase=0, mode="Point")
# MODEL1 : Unstable Structure
linetobeam = LineToBeamKaramba3D(Line=item.Item, Identifier="beam1", New=True, Remove=True, LimitDistance_m=0.005)  # -> Element, Points, Info
linetobeam_2 = LineToBeamKaramba3D(Line=item.Item1, Identifier="beam2", New=True, Remove=True, LimitDistance_m=0.005)  # -> Element, Points, Info
linetobeam_3 = LineToBeamKaramba3D(Line=item.Item2, Identifier="beam3", New=True, Remove=True, LimitDistance_m=0.005)  # -> Element, Points, Info
merge = Merge(Data1=linetobeam.Element, Data2=linetobeam_2.Element, Data3=linetobeam_3.Element)
assemble = AssembleModelKaramba3D(Elem=merge, Support=supp, Load=loads, Joint=beam_joints, LimitDistance_m=0.005)  # -> Model, Info, Mass_kg, CenterOfGravity
analyze = AnalyzeKaramba3D(Model=assemble.Model)  # -> CalculatedModel, MaximumDisplacement_cm, ResultingForceOfGravity_kN, ElasticEnergy_kNm
modelview = ModelViewKaramba3D(Model=analyze.CalculatedModel, ResultFactors=1, ResultCase=-1)  # -> Model, DeformedMesh, DeformedAxes, DeformedModel
beamview = BeamViewKaramba3D(Model=modelview.Model)  # -> Model, MeshesOfRenderedBeams, DeformedBeamAxes, LegendColors, LegendTags

geo_2 = Geometry(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)
explode_2 = Explode(Curve=geo_2, Recursive=True)  # -> Segments, Vertices
item_4 = ListItem(List=explode_2.Segments, Index=0, Wrap=True)  # -> Item, Item1, Item2
X_2 = UnitX(Factor=Slider(10, range=0..10))
item_5 = ListItem(List=explode_2.Vertices, Index=0, Wrap=True)  # -> Item1, Item
item_6 = ListItem(List=explode_2.Vertices, Index=Slider(1, range=0..1), Wrap=True)
supp_2 = SupportKaramba3D(PosInd=[item_5.Item1, item_5.Item], menu=[buttons(on, on, on, on, off, off)])
beam_joints_2 = BeamJointsKaramba3D(
    ElementIdentifiers="beam2",
    CtKNMAtStartingNode=Vector(0, 0, 0),
    CrKNmRadAtStartingNode=Vector(0, 0, 0),
    CtKNMAtEndNode=Vector(0, 0, 0),
    CrKNmRadAtEndNode=Vector(0, 0, 0),
    menu=[buttons(off, off, off, off, off, off), buttons(off, off, off, off, off, off)])
loads_2 = LoadsKaramba3D(ForceVector=X_2, Local=False, PosInd=item_6, LCase=0, mode="Point")
# MODEL2 : Stable Structure
linetobeam_4 = LineToBeamKaramba3D(Line=item_4.Item, Identifier="beam1", New=True, Remove=True, LimitDistance_m=0.005)  # -> Element, Points, Info
linetobeam_5 = LineToBeamKaramba3D(Line=item_4.Item1, Identifier="beam2", New=True, Remove=True, LimitDistance_m=0.005)  # -> Element, Points, Info
linetobeam_6 = LineToBeamKaramba3D(Line=item_4.Item2, Identifier="beam3", New=True, Remove=True, LimitDistance_m=0.005)  # -> Element, Points, Info
merge_2 = Merge(Data1=linetobeam_4.Element, Data2=linetobeam_5.Element, Data3=linetobeam_6.Element)
assemble_2 = AssembleModelKaramba3D(Elem=merge_2, Support=supp_2, Load=loads_2, Joint=beam_joints_2, LimitDistance_m=0.005)  # -> Model, Info, Mass_kg, CenterOfGravity
analyze_2 = AnalyzeKaramba3D(Model=assemble_2.Model)  # -> CalculatedModel, MaximumDisplacement_cm, ResultingForceOfGravity_kN, ElasticEnergy_kNm
modelview_2 = ModelViewKaramba3D(Model=analyze_2.CalculatedModel, ResultFactors=1, ResultCase=-1)  # -> Model, DeformedMesh, DeformedAxes, DeformedModel
beamview_2 = BeamViewKaramba3D(Model=modelview_2.Model)  # -> Model, MeshesOfRenderedBeams, DeformedBeamAxes, LegendColors, LegendTags
