# Grasshopper definition karamba_sample.gh (Grasshopper 1.0.7)
# plug-ins: karambaGH

md_slider = MDSlider(SliderMode=0, slider_value=Point(0, 1, 0.5), x_domain=Domain(0, 1), y_domain=Domain(0, 1), z_domain=Domain(0, 1))
md_slider_2 = MDSlider(SliderMode=0, slider_value=Point(1, 0, 0.5), x_domain=Domain(0, 1), y_domain=Domain(0, 1), z_domain=Domain(0, 1))
md_slider_3 = MDSlider(SliderMode=0, slider_value=Point(0, 0, 0.5), x_domain=Domain(0, 1), y_domain=Domain(0, 1), z_domain=Domain(0, 1))
md_slider_4 = MDSlider(SliderMode=0, slider_value=Point(1, 1, 0.5), x_domain=Domain(0, 1), y_domain=Domain(0, 1), z_domain=Domain(0, 1))
geo = Geometry(<brep referenced from the Rhino model>)
number_slider = Slider(10, range=0..100)
mesh_uv = MeshSurface(Surface=geo, UCount=5, VCount=5, Overhang=True, Equalize=False)
evalsrf = EvaluateSurface(Surface=reparameterize(geo), Point=[md_slider, md_slider_2])  # -> Point, Normal, UDirection, VDirection, Frame
evalsrf_2 = EvaluateSurface(Surface=reparameterize(geo), Point=[md_slider_3, md_slider_4])  # -> Point, Normal, UDirection, VDirection, Frame
mesh_uv_2 = MeshSurface(Surface=geo, UCount=number_slider, VCount=number_slider, Overhang=True, Equalize=False)
supp = SupportKaramba3D(PosInd=evalsrf_2.Point, menu=[buttons(on, on, on, off, off, off)])
meshtoshell = MeshToShellKaramba3D(Mesh=mesh_uv, LimitDistance_m=0.005)  # -> Element, Points, Info
Z = UnitZ(Factor=Slider(10, range=0..10))
demesh = DeconstructMesh(Mesh=mesh_uv_2)  # -> Vertices, Faces, Colours, Normals
loads = LoadsKaramba3D(ForceVector=Z, Local=False, PosInd=evalsrf.Point, LCase=0, mode="Point")
loads_2 = LoadsKaramba3D(Vector=Vector(0, 0, -1), LCase=0, mode="Gravity")
assemble = AssembleModelKaramba3D(Elem=meshtoshell.Element, Support=supp, Load=loads, LimitDistance_m=0.005)  # -> Model, Info, Mass_kg, CenterOfGravity
analyze = AnalyzeKaramba3D(Model=assemble.Model)  # -> CalculatedModel, MaximumDisplacement_cm, ResultingForceOfGravity_kN, ElasticEnergy_kNm
shelllineresults = LineResultsOnShellsKaramba3D(
    AnalyzedModel=analyze.CalculatedModel,
    LayerPosition=0,
    ListOfSourcesOfPrincipalStressLinesLinesPoints=demesh.Vertices,
    SegmentLength_m=0.5,
    DA_deg=5,
    mode="PrincStress")  # -> AnalyzedModel, Lines1, Lines2
preview = CustomPreview(Geometry=shelllineresults.Lines2, Material=ColourSwatch(SwatchColor=RGB(0, 47, 255)))
shellview = ShellViewKaramba3D(Model=analyze.CalculatedModel, IndexOfLayer=0)  # -> Model, MeshesOfRenderedShells, LegendColors, LegendTags
preview_2 = CustomPreview(Geometry=shelllineresults.Lines1, Material=ColourSwatch(SwatchColor=RGB(255, 0, 0)))
legend = Legend(Colour=shellview.LegendColors, Tags=shellview.LegendTags, LegendType=1)
