# Grasshopper definition karamba_table.gh (Grasshopper 1.0.7)
# plug-ins: karambaGH

dom = ConstructDomain(DomainStart=Slider(0, range=0..100), DomainEnd=Slider(10, range=0..100))

# ---- group: define cross sections
cross_section = CrossSectionKaramba3D(FamilyNameOfCrossSection="DefaultCroSec", Diameter_cm="30", WallThickness_cm="2", mode="Circular Hollow")

# ---- group: Create Geometry
pt = Point(Point(0, 0, 0))
genes = GenePool(Decimals=2, Maximum=1, Minimum=0, Value=[0.21, 0.49, 0.76, 0.34, 0.47, 0.71])
planesrf = PlaneSurface(Plane=pt, XSize=Domain(0, 10), YSize=Domain(0, 10))
preview = CustomPreview(Geometry=planesrf, Shader=ColourSwatch(SwatchColor=RGBA(168, 168, 168, 67)))
dispatch = Dispatch(List=genes, DispatchPattern=[True, False])  # -> ListA, ListB
Z = UnitZ(Factor=10)
pt_2 = ConstructPoint(XCoordinate=dispatch.ListA, YCoordinate=dispatch.ListB, ZCoordinate=0)
# 03 - Optimization of an Irregular Structure
# Difficulty: Moderate (PRO Version only)
# A grid of beams is supported at five points. Columns from the base to the roof grid are stitched using Element Felting creating irregularity within the structure.
# The position of the support positions is optimized using galapagos based on the deflection.
move = Move(Geometry=planesrf, Motion=Z)  # -> Geometry, Transform
sdivide = DivideSurface(Surface=move.Geometry, UCount=Slider(2, range=2..10), VCount=Slider(2, range=2..10))  # -> Points, Normals, Parameters
flip = FlipMatrix(Data=sdivide.Points)
pline = PolyLine(Vertices=sdivide.Points, Closed=False)
pline_2 = PolyLine(Vertices=flip, Closed=False)
explode = Explode(Curve=[pline_2, pline], Recursive=True)  # -> Segments, Vertices

# ----
planesrf_2 = PlaneSurface(Plane=pt, XSize=dom, YSize=dom)

# ---- group: Create Geometry (continued)
sdivide_2 = DivideSurface(Surface=planesrf_2, UCount=1, VCount=1)  # -> flatten(Points), Normals, Parameters
item = ListItem(List=sdivide_2.Points, Index=0, Wrap=True)  # -> Item, Item1, Item2
evalsrf = EvaluateSurface(Surface=reparameterize(planesrf_2), Point=pt_2)  # -> Point, Normal, UDirection, VDirection, Frame
aligndim = AlignedDimension(
    Plane=PlaneXY(0, 0, 0),
    PointA=[item.Item, item.Item2],
    PointB=[item.Item1, item.Item],
    Offset=1,
    Text="{0:0.00}",
    Size=0.5)
cp = ClosestPoint(Point=evalsrf.Point, Cloud=flatten(explode.Vertices))  # -> ClosestPoint, CPIndex, Distance
ln = Line(StartPoint=cp.ClosestPoint, EndPoint=evalsrf.Point)
entwine = Entwine(Branch00=explode.Segments, Branch01=ln, FlattenInputs=True)

# ---- group: Define Loads
Z_2 = UnitZ(Factor="-2")
loads = LoadsKaramba3D(Vector=Vector(0, 0, -1), LCase=0, mode="Gravity")
loads_2 = LoadsKaramba3D(ForceVector=Z_2, Local=False, PosInd=explode.Vertices, LCase=0, mode="Point")
load = LoadKaramba3D([loads_2, loads])

# ---- group: Define Elements
panel = Panel("""roof
columns""")
linetobeam = LineToBeamKaramba3D(Line=entwine, Identifier=graft(panel), CrossSection=cross_section, New=True, Remove=True, LimitDistance_m=0.005)  # -> Element, Points, Info

# ---- group: Define Supports
supp = SupportKaramba(PosInd=evalsrf.Point, menu=[buttons(on, on, on, off, off, off)])

# ---- group: Assemble Model
assemble = AssembleModelKaramba(Elem=flatten(linetobeam.Element), Support=supp, Load=flatten(load), LDist=0.005)  # -> Model, Info, Mass, CenterOfGravity

# ---- group: Apply Element Felting
elemfelting = ElementFeltingKaramba(
    Model=assemble.Model,
    LimitDistance=Slider(7.4, range=0.5..10),
    SnapLength=Slider(0.5, range=0.05..0.5),
    MaximumElementLength=-1,
    StartingElementIndex=0,
    MaximumNumberOfConnections=-1)

# ---- group: Analyze Model
analyze = AnalyzeKaramba3D(Model=elemfelting)  # -> CalculatedModel, MaximumDisplacement_cm, ResultingForceOfGravity_kN, ElasticEnergy_kNm

# ---- group: Optimisation of Form with Galapagos
galapagos = Galapagos(fitness=displace, gene=genes)
displace = Number(analyze.MaximumDisplacement_cm)
panel_2 = Panel(displace)

# ---- group: View Results
modelview = ModelViewKaramba3D(Model=analyze.CalculatedModel, LoadCaseFactorsForLinearSuperposition=1, IndexOfVisibleLoadcase=-1)  # -> Model, DeformedMesh, DeformedAxes, DeformedModel
beamview = BeamViewKaramba(Model=modelview.Model)  # -> Model, MeshOfRendering, DeformedBeamAxes, LegendColors, LegendTags
