# Grasshopper definition Karamba_CheckStatic.gh (Grasshopper 1.0.7)
# plug-ins: karambaGH

geo = Geometry(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)
explode = Explode(Curve=geo, Recursive=True)  # -> graft(Segments), Vertices
entwine = Entwine(Branch00=Toggle(True), Branch01=Toggle(False), Branch02=Toggle(True), FlattenInputs=True)
item = ListItem(List=explode.Vertices, Index=0, Wrap=True)  # -> Item1, Item
X = UnitX(Factor=Slider(10, range=0..10))
item_2 = ListItem(List=explode.Vertices, Index=Slider(1, range=0..1), Wrap=True)
panel = Panel("""beam1
beam2
beam3""")
supp = SupportKaramba3D(PosInd=[item.Item1, item.Item], menu=[buttons(on, on, on, on, off, on)])
# MODEL1 : Unstable Structure
linetobeam = LineToBeamKaramba3D(Line=explode.Segments, Identifier=graft(panel), New=True, Remove=True, LimitDistance_m=0.005, Bending=entwine)  # -> Element, Points, Info
loads = LoadsKaramba3D(ForceVector=X, Local=False, PosInd=item_2, LCase=0, mode="Point")
assemble = AssembleModelKaramba3D(Elem=flatten(linetobeam.Element), Support=supp, Load=loads, LimitDistance_m=0.005)  # -> Model, Info, Mass_kg, CenterOfGravity
analyze = AnalyzeKaramba3D(Model=assemble.Model)  # -> CalculatedModel, MaximumDisplacement_cm, ResultingForceOfGravity_kN, ElasticEnergy_kNm
modelview = ModelViewKaramba3D(Model=analyze.CalculatedModel, ResultFactors=1, ResultCase=-1)  # -> Model, DeformedMesh, DeformedAxes, DeformedModel
beamview = BeamViewKaramba3D(Model=modelview.Model)  # -> Model, MeshesOfRenderedBeams, DeformedBeamAxes, LegendColors, LegendTags

geo_2 = Geometry(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)
explode_2 = Explode(Curve=geo_2, Recursive=True)  # -> graft(Segments), Vertices
entwine_2 = Entwine(Branch00=Toggle(True), Branch01=Toggle(True), Branch02=Toggle(False), FlattenInputs=True)
item_3 = ListItem(List=explode_2.Vertices, Index=0, Wrap=True)  # -> Item1, Item
X_2 = UnitX(Factor=Slider(10, range=0..10))
item_4 = ListItem(List=explode_2.Vertices, Index=Slider(1, range=0..1), Wrap=True)
panel_2 = Panel("""beam1
beam2
beam3""")
supp_2 = SupportKaramba3D(PosInd=[item_3.Item1, item_3.Item], menu=[buttons(on, on, on, on, off, on)])
# MODEL2 : Stable Structure
linetobeam_2 = LineToBeamKaramba3D(Line=explode_2.Segments, Identifier=graft(panel_2), New=True, Remove=True, LimitDistance_m=0.005, Bending=entwine_2)  # -> Element, Points, Info
loads_2 = LoadsKaramba3D(ForceVector=X_2, Local=False, PosInd=item_4, LCase=0, mode="Point")
assemble_2 = AssembleModelKaramba3D(Elem=flatten(linetobeam_2.Element), Support=supp_2, Load=loads_2, LimitDistance_m=0.005)  # -> Model, Info, Mass_kg, CenterOfGravity
analyze_2 = AnalyzeKaramba3D(Model=assemble_2.Model)  # -> CalculatedModel, MaximumDisplacement_cm, ResultingForceOfGravity_kN, ElasticEnergy_kNm
modelview_2 = ModelViewKaramba3D(Model=analyze_2.CalculatedModel, ResultFactors=1, ResultCase=-1)  # -> Model, DeformedMesh, DeformedAxes, DeformedModel
beamview_2 = BeamViewKaramba3D(Model=modelview_2.Model)  # -> Model, MeshesOfRenderedBeams, DeformedBeamAxes, LegendColors, LegendTags
