# Grasshopper definition Karamba_Table_2.gh (Grasshopper 1.0.7)
# plug-ins: karambaGH

genes = GenePool(Decimals=2, Maximum=1, Minimum=0, Value=[0.47, 0.5, 0.53, 0.21, 0.49, 0.63])
genes_2 = GenePool(Decimals=2, Maximum=1, Minimum=0, Value=[0.46, 0.63, 0.06, 0.68, 0.26, 0.21])
genes_3 = GenePool(Decimals=2, Maximum=1, Minimum=0, Value=[0.5, 0.57, 0.62, 0.89, 0.5, 0.91])
genes_4 = GenePool(Decimals=2, Maximum=1, Minimum=0, Value=[0.62, 0.13, 0.81, 0.24, 0.51, 0.57])
genes_5 = GenePool(Decimals=2, Maximum=1, Minimum=0, Value=[0.57, 0.8, 0.33, 0.41, 0.38, 0.16])
genes_6 = GenePool(Decimals=2, Maximum=1, Minimum=0, Value=[0.66, 0.89, 0.49, 0.67, 0.64, 0.46])
genes_7 = GenePool(Decimals=2, Maximum=1, Minimum=0, Value=[0.34, 0.35, 0.35, 0.14, 0.36, 0.28])
genes_8 = GenePool(Decimals=2, Maximum=1, Minimum=0, Value=[0.32, 0.32, 0.37, 0.4, 0.7, 0.51])
number_slider = Slider(5, range=0..10)
srf = Surface(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)
srf_2 = Surface([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])
entwine = Entwine(Branch00=genes_8, Branch01=genes, Branch02=genes_2, Branch03=genes_3, FlattenInputs=True)
entwine_2 = Entwine(Branch00=genes_4, Branch01=genes_5, Branch02=genes_6, Branch03=genes_7, FlattenInputs=True)
panel = Panel("""1
0""")
panel_2 = Panel("""1
0""")
sdivide = DivideSurface(Surface=srf, UCount=number_slider, VCount=number_slider)  # -> Points, Normals, Parameters
dispatch = Dispatch(List=entwine_2, DispatchPattern=panel_2)  # -> ListA, ListB
mesh_uv = MeshSurface(Surface=srf, UCount=number_slider, VCount=number_slider, Overhang=True, Equalize=False)
galapagos = Galapagos(fitness=num, gene=[genes_8, genes, genes_2, genes_3, genes_4, genes_5, genes_6, genes_7])
dispatch_2 = Dispatch(List=entwine, DispatchPattern=panel)  # -> ListA, ListB
flip = FlipMatrix(Data=sdivide.Points)
pt = ConstructPoint(XCoordinate=dispatch.ListA, YCoordinate=dispatch.ListB, ZCoordinate=0)
pline = PolyLine(Vertices=sdivide.Points, Closed=False)
pt_2 = ConstructPoint(XCoordinate=dispatch_2.ListA, YCoordinate=dispatch_2.ListB, ZCoordinate=0)
pline_2 = PolyLine(Vertices=flip, Closed=False)
evalsrf = EvaluateSurface(Surface=reparameterize(graft(srf_2)), Point=pt)  # -> Point, Normal, UDirection, VDirection, Frame
evalsrf_2 = EvaluateSurface(Surface=reparameterize(srf), Point=pt_2)  # -> Point, Normal, UDirection, VDirection, Frame
explode = Explode(Curve=[pline, pline_2], Recursive=True)  # -> Segments, flatten(Vertices)
cp = ClosestPoint(Point=evalsrf_2.Point, Cloud=explode.Vertices)  # -> ClosestPoint, CPIndex, Distance
ln = Line(StartPoint=cp.ClosestPoint, EndPoint=evalsrf.Point)
meshtoshell = MeshToShellKaramba3D(Mesh=mesh_uv, LimitDistance_m=0.005)  # -> Element, Points, Info
pipe = Pipe(Curve=ln, Radius=Slider(0.1, range=0..1), Caps=0)
end = EndPoints(Curve=ln)  # -> Start, flatten(End)
entwine_3 = Entwine(Branch00=flatten(explode.Segments), Branch01=flatten(ln), FlattenInputs=True)
preview = CustomPreview(Geometry=pipe, Material=ColourSwatch(SwatchColor=RGB(255, 255, 255)))
panel_3 = Panel("""roof
column""")
Z = UnitZ(Factor=1)
supp = SupportKaramba3D(PosInd=end.End, menu=[buttons(on, on, on, off, off, off)])
neg = Negative(Value=Z)
linetobeam = LineToBeamKaramba3D(Line=entwine_3, Identifier=panel_3, New=True, Remove=True, LimitDistance_m=0.005)  # -> Element, Points, Info
loads = LoadsKaramba3D(Vector=neg, LCase=0, mode="Gravity")
assemble = AssembleModelKaramba3D(Elem=flatten([linetobeam.Element, meshtoshell.Element]), Support=supp, Load=loads, LimitDistance_m=0.005)  # -> Model, Info, Mass_kg, CenterOfGravity
analyze = AnalyzeKaramba3D(Model=assemble.Model)  # -> CalculatedModel, MaximumDisplacement_cm, ResultingForceOfGravity_kN, ElasticEnergy_kNm
num = Number(analyze.MaximumDisplacement_cm)
modelview = ModelViewKaramba3D(Model=analyze.CalculatedModel, ResultFactors=1, ResultCase=-1)  # -> Model, DeformedMesh, DeformedAxes, DeformedModel
shellview = ShellViewKaramba3D(Model=modelview.Model, IndexOfLayer=0)  # -> Model, MeshesOfRenderedShells, LegendColors, LegendTags
beamview = BeamViewKaramba3D(Model=modelview.Model)  # -> Model, MeshesOfRenderedBeams, DeformedBeamAxes, LegendColors, LegendTags
legend = Legend(Colour=beamview.LegendColors, Tags=beamview.LegendTags, LegendType=101)
