# Grasshopper definition karamba_table.gh (Grasshopper 1.0.7)
# plug-ins: karambaGH

# ---- group: Modeling
genes = GenePool(Decimals=2, Maximum=1, Minimum=0, Value=[0.46, 0.5, 0.38, 0.29, 0.76, 0.56, 0.21, 0.31, 0.2, 0.61, 0.36, 0.26])
genes_2 = GenePool(Decimals=2, Maximum=1, Minimum=0, Value=[0.32, 0.42, 0.56, 0.32, 0.58, 0.51, 0.44, 0.63, 0.59, 0.49, 0.27, 0.69])
dom = ConstructDomain(DomainStart=0, DomainEnd=Slider(5, range=0..10))
planesrf = PlaneSurface(Plane=PlaneXY(0, 0, 0), XSize=dom, YSize=dom)
Z = UnitZ(Factor=Slider(3, range=0..10))
dispatch = Dispatch(List=genes_2, DispatchPattern=[True, False])  # -> ListA, ListB
dispatch_2 = Dispatch(List=genes, DispatchPattern=[True, False])  # -> ListA, ListB
move = Move(Geometry=planesrf, Motion=Z)  # -> Geometry, Transform
number_slider = Slider(5, range=0..10)
pt = ConstructPoint(XCoordinate=dispatch_2.ListA, YCoordinate=dispatch_2.ListB, ZCoordinate=0)
pt_2 = ConstructPoint(XCoordinate=dispatch.ListA, YCoordinate=dispatch.ListB, ZCoordinate=0)
evalsrf = EvaluateSurface(Surface=reparameterize(planesrf), Point=pt)  # -> Point, Normal, UDirection, VDirection, Frame
evalsrf_2 = EvaluateSurface(Surface=reparameterize(move.Geometry), Point=pt_2)  # -> Point, Normal, UDirection, VDirection, Frame
sdivide = DivideSurface(Surface=move.Geometry, UCount=number_slider, VCount=number_slider)  # -> Points, Normals, Parameters
flip = FlipMatrix(Data=sdivide.Points)
pline = PolyLine(Vertices=sdivide.Points, Closed=False)
pline_2 = PolyLine(Vertices=flip, Closed=False)
explode = Explode(Curve=[pline, pline_2], Recursive=True)  # -> Segments, Vertices
cp = ClosestPoint(Point=evalsrf_2.Point, Cloud=flatten(explode.Vertices))  # -> ClosestPoint, CPIndex, Distance
ln = Line(StartPoint=evalsrf.Point, EndPoint=cp.ClosestPoint)
entwine = Entwine(Branch00=explode.Segments, Branch01=ln, FlattenInputs=True)

# ---- group: Karamba
matselect = MaterialSelectionKaramba3D(menu=[dropdown(1), dropdown(2)])
cross_section = CrossSectionKaramba3D(
    FamilyNameOfCrossSection="DefaultCroSec",
    Material=matselect,
    Height_cm="30",
    UpperFlangeWidth_cm=10,
    LowerFlangeWidth_cm=10,
    UpperFlangeThickness_cm=0.8,
    LowerFlangeThickness_cm=0.8,
    WebThickness_cm=0.5,
    FilletRadius_cm=0,
    mode="I")
cross_section_2 = CrossSectionKaramba3D(
    FamilyNameOfCrossSection="DefaultCroSec",
    Material=matselect,
    Diameter_cm="20",
    WallThickness_cm="2",
    mode="Circular Hollow")
Z_2 = UnitZ(Factor=1)
rdpoints = RemoveDuplicatePointsKaramba3D(Point=flatten(explode.Vertices), LimitDistance=0.005)  # -> OutPoint, Info, Indexes
Z_3 = UnitZ(Factor=1)
panel = Panel("""roof
column""")
end = EndPoints(Curve=ln)  # -> Start, End
neg = Negative(Value=Z_2)
neg_2 = Negative(Value=Z_3)
supp = SupportKaramba3D(PosInd=end.Start, menu=[buttons(on, on, on, off, off, off)])
entwine_2 = Entwine(Branch00=cross_section, Branch01=cross_section_2, FlattenInputs=True)
linetobeam = LineToBeamKaramba3D(Line=entwine, Identifier=graft(panel), CrossSection=entwine_2, New=True, Remove=True, LimitDistance_m=0.005)  # -> flatten(Element), Points, Info
loads = LoadsKaramba3D(Vector=neg_2, LCase=0, mode="Gravity")
loads_2 = LoadsKaramba3D(ForceVector=neg, Local=False, PosInd=rdpoints.OutPoint, LCase=0, mode="Point")
merge = Merge(Data1=loads, Data2=loads_2)  # -> flatten(Result)
assemble = AssembleModelKaramba3D(Elem=linetobeam.Element, Support=supp, Load=merge, LimitDistance_m=0.005)  # -> Model, Info, Mass_kg, CenterOfGravity
analyze = AnalyzeKaramba3D(Model=assemble.Model)  # -> CalculatedModel, MaximumDisplacement_cm, ResultingForceOfGravity_kN, ElasticEnergy_kNm
modelview = ModelViewKaramba3D(Model=analyze.CalculatedModel, ResultFactors=1, ResultCase=-1)  # -> Model, DeformedMesh, DeformedAxes, DeformedModel
beamview = BeamViewKaramba3D(Model=modelview.Model)  # -> Model, MeshesOfRenderedBeams, DeformedBeamAxes, LegendColors, LegendTags

# ---- group: Optimize
galapagos = Galapagos(fitness=num, gene=[genes, genes_2])
num = Number(analyze.MaximumDisplacement_cm)
