# Grasshopper definition CrossSectionOpt.gh (Grasshopper 1.0.7)
# plug-ins: karambaGH

X = UnitX(Factor=1)
pt = Point(Point(0, 0, 0))
range = Range(Domain=Domain(0, 1), Steps=Slider(6, range=1..20))
line = LineSDL(Start=pt, Direction=X, Length=Slider(20, range=1..30))
line_2 = Line(line)
end = EndPoints(Curve=line_2)  # -> Start, End
shatter = Shatter(Curve=line, Parameters=range)
Z = UnitZ(Factor="-110")
path = FilePath("D:\Repos\TAEC-handson\201010_Structural_Analysis_Coding_with_Karamba_by_hiron\Data\JP_CrossSectionValues.csv")
supp = SupportKaramba3D(PosInd=end.Start, menu=[buttons(on, on, on, on, on, on)])
linetobeam = LineToBeamKaramba3D(Line=shatter, New=True, Remove=True, LimitDistance_m=0.005)  # -> Element, Points, Info
loads = LoadsKaramba3D(ForceVector=Z, Local=False, PosInd=end.End, LCase=0, mode="Point")
readcstable = ReadCrossSectionTableFromFileKaramba3D(FilePathOfCrossSectionTable=path)  # -> CrossSection, Info
crosecrselect = CrossSectionRangeSelectorKaramba3D(
    CrossSections=readcstable.CrossSection,
    MaximumHeight_cm=Slider(62, range=0..100),
    MaximumWidth_cm=Slider(50, range=0..100),
    menu=[dropdown(0), dropdown(0), dropdown(0)])
assemble = AssembleModelKaramba3D(Elem=linetobeam.Element, Support=supp, Load=loads, LimitDistance_m=0.005)  # -> Model, Info, Mass_kg, CenterOfGravity
c_script = CSharpScript(
    modelIn=assemble.Model,
    croSecsIn=crosecrselect,
    nIter="10",
    lcInd="0",
    Reference=["C:\Program Files\Rhino 6\Plug-ins\karambaCommon.dll", "C:\Program Files\Rhino 6\Plug-ins\karamba.gha", "C:\Users\hnatsume\AppData\Roaming\Grasshopper\Libraries\Karamba\karambaCommon.dll", "C:\Users\hnatsume\AppData\Roaming\Grasshopper\Libraries\Karamba\karamba.gha"])  # -> out, modelOut, dispOut; inputs croSecsIn: list, nIter: Int32, lcInd: Int32
# ---------- c_script: C# usings ----------
using System.Linq;
using Karamba.Models;
using Karamba.CrossSections;
using Karamba.Elements;
using Karamba.Results;
# ---------- c_script: C# ----------
    var model = modelIn as Model;

    var croSecs = new List<CroSec_Beam>(croSecsIn.Count);
    croSecs.AddRange(croSecsIn.Select(item => item as CroSec_Beam));

    var k3d = new KarambaCommon.Toolkit();
    List<double> maxDisp;
    List<double> outG;
    List<double> outComp;
    string message;
    List<List<double>> N;
    List<List<double>> V;
    List<List<double>> M;

    // avoid side effects
    model = model.Clone();
    model.cloneElements();

    for (int i = 0; i < nIter; ++i) {
      model = k3d.Algorithms.AnalyzeThI(model, out maxDisp, out outG, out outComp, out message);

      for (int elemInd = 0; elemInd < model.elems.Count; ++elemInd) {
        var beam = model.elems[elemInd] as ModelBeam;
        if (beam == null) continue;

        // avoid side effects
        beam = (ModelBeam) beam.Clone();
        model.elems[elemInd] = beam;

        BeamResultantForces.solve(model, new List<string> {"" + elemInd}, lcInd, 100, 1,
          out N, out V, out M);

        foreach (var croSec in croSecs)
        {
          beam.crosec = croSec;
          var maxSigma = Math.Abs(N[lcInd][0]) / croSec.A + M[lcInd][0] / croSec.Wely_z_pos;
          if (maxSigma < croSec.material.fy()) break;
        }
      }

      model.initMaterialCroSecLists();
      model.febmodel = model.buildFEModel();
    }

    model = k3d.Algorithms.AnalyzeThI(model, out maxDisp, out outG, out outComp, out message);

    dispOut = new GH_Number(maxDisp[lcInd]);
    modelOut = new Karamba.GHopper.Models.GH_Model(model);
# ---------- end c_script ----------
panel = Panel(c_script.dispOut)
disassemble = DisassembleModelKaramba3D(Model=c_script.modelOut)  # -> Model, Point, Beam, Shell, Support, Load, Line, Mesh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
modelview = ModelViewKaramba3D(Model=c_script.modelOut, ResultFactors=1, ResultCase=-1)  # -> Model, DeformedMesh, DeformedAxes, DeformedModel
assemble_2 = AssembleModelKaramba3D(Elem=disassemble.Beam, Support=disassemble.Support, Load=disassemble.Load, LimitDistance_m=0.005)  # -> Model, Info, Mass_kg, CenterOfGravity
beamview = BeamViewKaramba3D(Model=modelview.Model)  # -> Model, MeshesOfRenderedBeams, DeformedBeamAxes, LegendColors, LegendTags
analyze = AnalyzeKaramba3D(Model=assemble_2.Model)  # -> CalculatedModel, MaximumDisplacement_cm, ResultingForceOfGravity_kN, ElasticEnergy_kNm
panel_2 = Panel(analyze.MaximumDisplacement_cm)
legend = Legend(Colour=beamview.LegendColors, Tags=beamview.LegendTags, LegendType=1)
